# Dynamo graph safe-cracker-dynamo.dyn (Dynamo 2.17.1.4055)

code_block = CodeBlock()  # unwired: numbers
# ---------- code_block.designscript (19 lines) ----------
numbers;

[Imperative]
{
    // Input: list of numbers
    //numbers = IN[0];
    result = [];

    // Start with the first item
    result[0] = numbers[0];

    // Loop through the list starting from index 1
    for (i in 1..(List.Count(numbers)-1))
    {
        result[i] = result[i-1] + numbers[i];
    }

    return = result;
};
# ----------------------------------------
code_block_2 = CodeBlock { 1050; }
file_path = Filename("C:\Users\abear\OneDrive - Wessex Water\code\github\advent-of-code\2025\day-01\input.txt")
readText = FileSystem.ReadText(file=file_path)
code_block_3 = CodeBlock { "\n"; ","; }
replace = String.Replace(string=readText, searchFor=code_block_3.out0, replaceWith=code_block_3.out1)
code_block_4 = CodeBlock { ","; }
split = String.Split(string=replace, separator0=code_block_4)
code_block_5 = CodeBlock { "L"; "-"; }
replace_2 = String.Replace(string=split, searchFor=code_block_5.out0, replaceWith=code_block_5.out1)
code_block_6 = CodeBlock { "R"; ""; }
replace_3 = String.Replace(string=replace_2, searchFor=code_block_6.out0, replaceWith=code_block_6.out1)
toNumber = String.ToNumber(string=replace_3)
addItemToFront = List.AddItemToFront(item=code_block_2, list=toNumber)
